# Dynamo graph CAD to Revit Beams n Grids.dyn (Dynamo 2.6.1.8786)
# packages: bimorphNodes 4.1.2

# group: Grids
select_model_element = DSModelElementSelection()  # 1 picked in the model
code_block = CodeBlock { "Grids"; }
boolean = BoolSelector(false)
curvesFromCADLayers = CAD.CurvesFromCADLayers(importInstance=select_model_element, layerNames=code_block, createModelCurves=boolean)
byLine = Grid.ByLine(line=curvesFromCADLayers.Curve)

# group: Selectin DWG & Layer
select_model_element_2 = DSModelElementSelection()  # 1 picked in the model
code_block_2 = CodeBlock { "Beams"; }
boolean_2 = BoolSelector(false)
curvesFromCADLayers_2 = CAD.CurvesFromCADLayers(importInstance=select_model_element_2, layerNames=code_block_2, createModelCurves=boolean_2)

# group: Sorting Start Points
startPoint = Curve.StartPoint(curve=curvesFromCADLayers_2.Curve@L1)
X = Point.X(point=startPoint)
sortByKey = List.SortByKey(list=startPoint, keys=X)
code_block_3 = CodeBlock { 1; 2; }
dropEveryNthItem = List.DropEveryNthItem(list=sortByKey.sorted_list@L2, n=code_block_3.out1)
dropEveryNthItem_2 = List.DropEveryNthItem(list=sortByKey.sorted_list@L2, n=code_block_3.out1, offset=code_block_3.out0)

# group: Creating Centred Start Points
byTwoPoints = Vector.ByTwoPoints(start=dropEveryNthItem, end=dropEveryNthItem_2, lacing=Shortest)
distanceTo = Geometry.DistanceTo(geometry=dropEveryNthItem, other=dropEveryNthItem_2)
code_block_4 = CodeBlock { 2; }
div = distanceTo / code_block_4
translate = Geometry.Translate(geometry=dropEveryNthItem, direction=byTwoPoints, distance=div)

# group: Sorting End Points
endPoint = Curve.EndPoint(curve=curvesFromCADLayers_2.Curve@L1)
X_2 = Point.X(point=endPoint)
sortByKey_2 = List.SortByKey(list=endPoint, keys=X_2)
code_block_5 = CodeBlock { 1; 2; }
dropEveryNthItem_3 = List.DropEveryNthItem(list=sortByKey_2.sorted_list@L2, n=code_block_5.out1)
dropEveryNthItem_4 = List.DropEveryNthItem(list=sortByKey_2.sorted_list@L2, n=code_block_5.out1, offset=code_block_5.out0)

# group: Creating centred End Points
byTwoPoints_2 = Vector.ByTwoPoints(start=dropEveryNthItem_3, end=dropEveryNthItem_4, lacing=Shortest)
distanceTo_2 = Geometry.DistanceTo(geometry=dropEveryNthItem_3, other=dropEveryNthItem_4)
code_block_6 = CodeBlock { 2; }
div_2 = distanceTo_2 / code_block_6
translate_2 = Geometry.Translate(geometry=dropEveryNthItem_3, direction=byTwoPoints_2, distance=div_2)

# group: Constructing Revit Beams
byStartPointEndPoint = Line.ByStartPointEndPoint(startPoint=translate, endPoint=translate_2)
levels = Levels("Level 2")
structural_framing_types = StructuralFramingTypes("300 x 600mm")
beamByCurve = StructuralFraming.BeamByCurve(curve=byStartPointEndPoint, level=levels, structuralFramingType=structural_framing_types)
